# Dynamo graph Revit to X-frame 3D.dyn (Dynamo 2.3.0.5885)
# packages: Clockwork for Dynamo 2.x 2.1.2

code_block = CodeBlock { "Grids"; }
byName = Category.ByName(name=code_block)
all_elements_of_category = ElementsOfCategory(Category=byName)
select_model_elements = DSModelElementsSelection()  # 322 picked in the model
category = Custom[Element.Category+](element=select_model_elements)  # package Clockwork for Dynamo 2.x; Returns the category of a given element. Unlike the OOTB node Element.GetCategory, it will work for subcategories, families, family documents, schedules, subcategories and graphics styles as well.
name = Category.Name(category=category)
code_block_2 = CodeBlock { "Analytical Nodes"; }
eq = name == code_block_2
filterByBoolMask = List.FilterByBoolMask(list=select_model_elements, mask=eq)
code_block_3 = CodeBlock { "Analytical Beams"; }
eq_2 = name == code_block_3
filterByBoolMask_2 = List.FilterByBoolMask(list=select_model_elements, mask=eq_2)
code_block_4 = CodeBlock { "Analytical Columns"; }
eq_3 = name == code_block_4
filterByBoolMask_3 = List.FilterByBoolMask(list=select_model_elements, mask=eq_3)
xframe3DExportXML = Custom[Xframe3DExportXML](Grids=all_elements_of_category, AnalyticalNodes=filterByBoolMask.in, AnalyticalBeams=filterByBoolMask_2.in, AnalyticalColumns=filterByBoolMask_3.in)

# group: WRITE TO FILE
code_block_5 = CodeBlock { "C:/TEMP/test98.xml"; }
writeText = FileSystem.WriteText(filePath=code_block_5, text=xframe3DExportXML)

byName_2 = Category.ByName(name=code_block_4)
all_elements_of_category_2 = ElementsOfCategory(Category=byName_2)
byName_3 = Category.ByName(name=code_block_3)
all_elements_of_category_3 = ElementsOfCategory(Category=byName_3)
byName_4 = Category.ByName(name=code_block_2)
all_elements_of_category_4 = ElementsOfCategory(Category=byName_4)
