# Dynamo graph Xframe3D Supports to Revit.dyn (Dynamo 2.3.0.5885)

file_path = Filename("..\..\..\..\..\..\..\3BM\50_projecten\3_3BM_bouwtechniek\1256_Berekening_woning_Oudekerk_aan_de_Ijssel\1256_71_constructie_advies\1256-5.6 Fundering.xml")  # graph input
xframe3DImportXML = Custom[Xframe3DImportXML](xmlFile=file_path)  # Import Xframe3D XML and convert to points, lines and metadata
watch = Watch(xframe3DImportXML.nodes)
watch_2 = Watch(xframe3DImportXML.support_nodenumber)
toNumber = String.ToNumber(str=watch_2)
python_script = Python(IN[0]=xframe3DImportXML.nodeNumbers, IN[1]=toNumber)
# ---------- python_script.python (15 lines) ----------
import clr
clr.AddReference('ProtoGeometry')
from Autodesk.DesignScript.Geometry import *
#The inputs to this node will be stored as a list in the IN variables.
dataEnteringNode = IN

lst = IN[0]
value = IN[1]

indices = []
for i in value:
	indices.append(lst.index(i))

#Assign your output to the OUT variable.
OUT = indices
# ----------------------------------------
getItemAtIndex = List.GetItemAtIndex(list=xframe3DImportXML.nodes, index=python_script)
code_block = CodeBlock { 200; }
byCenterPointRadius = Circle.ByCenterPointRadius(centerPoint=getItemAtIndex, radius=code_block)

# group: PLACE PILES
family_types = FamilyTypes("NLRS_17_SF_funderingspaal:Type 1")
byPoint = FamilyInstance.ByPoint(familyType=family_types, point=getItemAtIndex)
